# Grasshopper definition 0.AllComponents.gh (Grasshopper 1.0.7)
# plug-ins: KUKA|prc - parametric robot control, plankton, Kangaroo2 Components, MultilingualGH

mgh = MultilingualGH(MGHKeepAnno=False, MGHLabelMethod=False, MGHLangSel="繁體中文", MGHUseDe=False, MGHenable=False)
dom = ConstructDomain(DomainStart=0, DomainEnd=1)  # disabled
dedomain = DeconstructDomain()  # -> Start, End; disabled
scale = Scale(Center=Point(0, 0, 0), Factor=0.5)  # -> Geometry, Transform; disabled
scale_nu = ScaleNU(Plane=PlaneXY(0, 0, 0), ScaleX=1, ScaleY=1, ScaleZ=1)  # -> Geometry, Transform; disabled
shear = Shear(Base=PlaneXY(0, 0, 0), Grip=Point(0, 0, 1), Target=Point(0, 0, 1))  # -> Geometry, Transform; disabled
cmyk = ColourCMYK(Cyan=0, Magenta=0, Yellow=0, Key=0)  # disabled
hsl = ColourHSL(Alpha=1, Hue=0, Saturation=1, Luminance=0.5)  # disabled
hsv = ColourHSV(Alpha=1, Hue=0, Saturation=1, Value=1)  # disabled
alignfaces = AlignFaces(Flip=False, Strength=1)  # disabled
beam = Beam(E=1, A=1, Ix=1, Iy=1, GJ=1)  # disabled
concentric = Concentric(Flip=False, Strength=1)  # disabled
pt = Point()  # disabled
vec = Vector()  # disabled
box_corners = BoxCorners()  # -> CornerA, CornerB, CornerC, CornerD, CornerE, CornerF, CornerG, CornerH; disabled
boxprop = BoxProperties()  # -> Center, Diagonal, Area, Volume, Degeneracy; disabled
debox = DeconstructBox()  # -> Plane, X, Y, Z; disabled
blx = BrepLine(LimitToFirst=False)  # -> Curves, Points; disabled
clx = CurveLine()  # -> Points, Params, Count; disabled
llx = LineLine()  # -> ParamA, ParamB, PointA, PointB; disabled
item = ListItem(Index=0, Wrap=True)  # disabled
lng = ListLength()  # disabled
sort = SortList()  # -> Keys, ValuesA; disabled
deface = DeconstructFace()  # -> CornerA, CornerB, CornerC, CornerD; disabled
demesh = DeconstructMesh()  # -> Vertices, Faces, Colours, Normals; disabled
facen = FaceNormals()  # -> Centers, Normals; disabled
lcharge = LineCharge(Charge=1)  # disabled
pcharge = PointCharge(Charge=1, Decay=2)  # disabled
fspin = SpinForce(Plane=PlaneXY(0, 0, 0), Strength=1, Radius=5, Decay=2)  # disabled
cpoly = ControlPolygon()  # -> Polygon, Points; disabled
midpt = CurveMiddle()  # disabled
end = EndPoints()  # -> Start, End; disabled
circle = Circle()  # disabled
arc = CircularArc()  # disabled
crv = Curve()  # disabled
bnd = Bounds()  # disabled
remap = RemapNumbers(Source=Domain(0, 1), Target=Domain(0, 1))  # -> Mapped, Clipped; disabled
consec = ConsecutiveDomains(Numbers=[0, 0.5, 1, 1.5, 2], Additive=True)  # disabled
shear_2 = ShearAngle(Base=PlaneXY(0, 0, 0))  # -> Geometry, Transform; disabled
co = CameraObscura(Point=Point(0, 0, 0), Factor=1)  # -> Geometry, Transform; disabled
rgb = ColourRGB(Alpha=255, Red=0, Green=0, Blue=0)  # disabled
frgb = ColourRGBF(Alpha=1, Red=0, Green=0, Blue=0)  # disabled
colourful = Colourful()  # disabled
rigidbody = RigidBody(Strength=10)  # -> RigidBody, Planes; disabled
rigidpointset = RigidPointSet(Strength=10)  # -> RigidBody, Planes; disabled
solidcollide = SolidCollide(Strength=1)  # disabled
split = SplitList()  # -> ListA, ListB; disabled
ins = InsertItems(Wrap=True)  # disabled
index = ItemIndex()  # disabled
medges = MeshEdges()  # -> NakedEdges, InteriorEdges, NonManifoldEdges; disabled
box = EvaluateBox(UParameter=0.5, VParameter=0.5, WParameter=0.5)  # -> Plane, Point, Include; disabled
meshray = MeshRay()  # -> Point, Hit; disabled
slx = SurfaceLine(LimitToFirst=False)  # -> Curves, Points, UVPoints, Normal; disabled
fvector = VectorForce()  # disabled
pcen = PolygonCenter()  # -> CenterV, CenterE, CenterA; disabled
cp = ControlPoints()  # -> Points, Weights, Knots; disabled
darc = DeconstructArc()  # -> BasePlane, Radius, Angle; disabled
line = Line()  # disabled
pln = Plane()  # disabled
rec = Rectangle()  # disabled
div = DivideDomain(Domain=Domain(0, 1), Count=10)  # disabled
fdom = FindDomain(Strict=False)  # -> Index, Neighbour; disabled
inc = Includes(Domain=Domain(0, 1))  # -> Includes, Deviation; disabled
partition = PartitionList(Size=[3, 2])  # disabled
replace = ReplaceItems(Wrap=False)  # disabled
rev = ReverseList()  # disabled
faceb = FaceBoundaries()  # disabled
minc = MeshInclusion(Strict=False)  # disabled
facec = FaceCircles()  # -> Centers, Ratio; disabled
edges = BrepEdges()  # -> Naked, Interior, NonManifold; disabled
debrep = DeconstructBrep()  # -> Faces, Edges, Vertices; disabled
topology = BrepTopology(PerspectiveOnly=False)  # -> FaceFaceAdjacency, FaceEdgeAdjacency, EdgeFaceAdjacency; disabled
orient = OrientDirection(PointA=Point(0, 0, 0), DirectionA=Vector(0, 0, 1), PointB=Point(0, 0, 0), DirectionB=Vector(0, 0, 1))  # -> Geometry, Transform; disabled
project = Project(Plane=PlaneXY(0, 0, 0))  # -> Geometry, Transform; disabled
boxmap = BoxMapping()  # -> Geometry, Transform; disabled
colour_l_ab = ColourLAb(Alpha=1, Luminance=0, A=1, B=0.5)  # disabled
lch = ColourLCH(Alpha=1, Luminance=0, Chroma=1, Hue=0.5)  # disabled
xyz = ColourXYZ(Alpha=1, X=0, Y=0, Z=0)  # disabled
solidplanecollide = SolidPlaneCollide(CollisionPlane=PlaneXY(0, 0, 0), Strength=1)  # disabled
support = Support(X=True, Y=True, Z=True, XX=True, YY=True, ZZ=True, Strength=100)  # disabled
breakf = BreakField()  # disabled
mergef = MergeFields()  # disabled
sec = BrepPlane(Plane=PlaneXY(0, 0, 0))  # -> Curves, Points; disabled
pcx = CurvePlane()  # -> Points, ParamsC, ParamsP; disabled
plx = LinePlane()  # -> Point, ParamL, ParamP; disabled
box_2 = Box()  # disabled
brep = Brep()  # disabled
mesh = Mesh()  # disabled
drec = DeconstuctRectangle()  # -> BasePlane, XInterval, YInterval; disabled
dom²num = ConstructDomain²(UMin=0, UMax=1, VMin=0, VMax=1)  # disabled
dom² = ConstructDomain²(DomainU=Domain(0, 1), DomainV=Domain(0, 1))  # disabled
dedom2 = DeconstructDomain²()  # -> UComponent, VComponent; disabled
shift = ShiftList(Shift=1, Wrap=True)  # disabled
subset = SubList(Wrap=True)  # -> List, Index; disabled
meshcp = MeshClosestPoint()  # -> Point, Index, Parameter; disabled
meval = MeshEval()  # -> Point, Normal, Colour; disabled
pmesh = PlanktonMesh()  # disabled
srf = Surface()  # disabled
face = MeshFace()  # disabled
wires = BrepWireframe(Density=-1)  # disabled
dim = Dimensions()  # -> UDimension, VDimension; disabled
planar = IsPlanar(Interior=True)  # -> Planar, Plane; disabled
evf = EvaluateField()  # -> Tensor, Strength; disabled
fline = FieldLine(Steps=1000, Accuracy=0.1, Method=3)  # disabled
projecta = ProjectAlong(Plane=PlaneXY(0, 0, 0), Direction=Vector(0, 0, -1))  # -> Geometry, Transform; disabled
recmap = RectangleMapping()  # -> Geometry, Transform; disabled
trimap = TriangleMapping()  # -> Geometry, Transform; disabled
ahsl = SplitAHSL()  # -> Alpha, Hue, Saturation, Luminance; disabled
ahsv = SplitAHSV()  # -> Alpha, Hue, Saturation, Value; disabled
argb = SplitARGB()  # -> Alpha, Red, Green, Blue; disabled
angle = Angle(Strength=1)  # disabled
as = AngleSnap(Factor=0.7853981634, Strength=1)  # disabled
clampangle = ClampAngle(UpperLimit=1.570796327, LowerLimit=0.7853981634, Strength=1)  # disabled
sec_2 = MeshPlane()  # disabled
ppx = PlanePlane()  # disabled
_3px = PlanePlanePlane()  # -> Point, LineAB, LineAC, LineBC; disabled
dedom2num = DeconstructDomain²()  # -> UMin, UMax, VMin, VMax; disabled
dispatch = Dispatch(DispatchPattern=[True, False])  # -> ListA, ListB; disabled
null = NullItem()  # -> NullFlags, InvalidFlags, Description; disabled
p_n_c = PickNChoose(Pattern=[0, 1])  # disabled
crv_cp = CurveClosestPoint()  # -> Point, Parameter, Distance; disabled
disc = Discontinuity(Level=1)  # -> Points, Parameters; disabled
cls = Closed()  # -> Closed, Periodic; disabled
subd = SubD()  # disabled
tbox = TwistedBox()  # disabled
conmesh = ConstructMesh(Vertices=[Point(0, 0, 0), Point(10, 0, 0), Point(10, 10, 0), Point(0, 10, 0)], Faces={A=0, B=1, C=2, D=3})  # disabled
mcol = MeshColours(Colours=[RGB(127, 255, 0), RGB(0, 100, 0), RGB(34, 139, 34), RGB(124, 252, 0), RGB(154, 205, 50), RGB(173, 255, 47), RGB(50, 205, 50), RGB(152, 251, 152)])  # disabled
quad = MeshQuad(CornerA=0, CornerB=1, CornerC=2, CornerD=3)  # disabled
srfpt = SurfacePoints()  # -> Points, Weights, Greville, UCount, VCount; disabled
fdir = DirectionDisplay(Samples=1000)  # disabled
fperp = PerpendicularDisplay(Samples=1000, PositiveColour=RGB(255, 255, 255), NegativeColour=RGB(0, 0, 0))  # disabled
fscalar = ScalarDisplay(Samples=1000)  # disabled
arrcurve = CurveArray(Count=10)  # -> Geometry, Transform; disabled
arrlinear = LinearArray(Direction=Vector(10, 0, 0), Count=10)  # -> Geometry, Transform; disabled
arrpolar = PolarArray(Plane=PlaneXY(0, 0, 0), Count=10, Angle=6.283185307)  # -> Geometry, Transform; disabled
tag = TextTag()  # disabled
tag_2 = TextTag3D(Size=1, Justification=7)  # disabled
ghatch = GradientHatch(Colour1=RGB(255, 20, 147), Colour2=RGB(139, 0, 139))  # disabled
ea = EqualAngle(Strength=1)  # disabled
g2 = G2(Strength=1)  # disabled
rod = Rod(LengthFactor=1, AngleFactor=1, AxialStrength=10, BendStrength=1)  # disabled
bnd_2 = Bounds2D()  # disabled
divide = DivideDomain²(UCount=10, VCount=10)  # disabled
contour = Contour(Point=Point(0, 0, 0), Direction=Vector(0, 0, 1))  # disabled
contour_2 = ContourEx(Plane=PlaneXY(0, 0, 0))  # disabled
plreg = PlaneRegion(Plane=PlaneXY(0, 0, 0))  # disabled
nullrep = ReplaceNulls()  # -> Items, Count; disabled
weave = Weave(Pattern=[0, 1], NullGaps=False)  # disabled
geometry_cache = GeometryCache(MaintainReferences=False)  # disabled
field = Field()  # disabled
geo = Geometry()  # disabled
crvgraph = CurvatureGraph(Density=5, Scale=105)  # disabled
crvnear = CurveNearestObject()  # -> PointA, PointB, Index; disabled
crvprox = CurveProximity()  # -> PointA, PointB, Distance; disabled
mspray = MeshSpray(SprayMode=11)  # disabled
triangle = MeshTriangle(CornerA=0, CornerB=1, CornerC=2)  # disabled
area = Area()  # -> Area, Centroid; disabled
volume = Volume()  # -> Volume, Centroid; disabled
amoments = AreaMoments()  # -> Area, Centroid, Inertia, InertiaError, Secondary, SecondaryError, Gyration; disabled
ftensor = TensorDisplay(Samples=1000)  # disabled
matrix = DisplayMatrix()  # disabled
pipeline = GeometryPipeline(
    GroupByLayer=False,
    GroupByType=False,
    IncludeHidden=True,
    IncludeLocked=True,
    LayerFilter="*",
    NameFilter="*",
    SublayerFiltering=True,
    TypeFilter=0)  # disabled
arrrec = RectangularArray(Cell={Plane=PlaneXY(0, 0, 0), Size=Domain2(u=0..10, v=0..5)}, XCount=6, YCount=3)  # -> Geometry, Transform; disabled
arrbox = BoxArray(Cell={Plane=PlaneXY(0, 0, 0), X=Domain(0, 10), Y=Domain(0, 5), Z=Domain(0, 2)}, XCount=4, YCount=3, ZCount=2)  # -> Geometry, Transform; disabled
phatch = PatternHatch(Pattern=0, Scale=1, Angle=0)  # disabled
cocircular = CoCircular(Strength=1)  # disabled
colinear = CoLinear(Strength=1)  # disabled
coplanar = CoPlanar(Strength=1)  # disabled
combine = CombineData()  # -> Result, Index; disabled
sift = SiftPattern(SiftPattern=[0, 0, 1, 1])  # -> Output0, Output1; disabled
ivist = IsoVist(Count=10, Radius=100)  # -> Points, Distance, Index; disabled
ivray = IsoVistRay(Radius=100)  # -> Point, Distance, Index; disabled
matrix_2 = ConstructMatrix(Rows=3, Columns=3)  # disabled
dematrix = DeconstructMatrix()  # -> Rows, Columns, Values; disabled
grp = Group()  # disabled
transform = Transform()  # disabled
side = CurveSide()  # -> Side, Left, Right; disabled
x_tremez = Extremes(Plane=PlaneXY(0, 0, 0))  # -> Highest, Lowest; disabled
planar_2 = Planar()  # -> Planar, Plane, Deviation; disabled
mplane = MeshPlane(Boundary={Plane=PlaneXY(0, 0, 0), Size=Domain2(u=-10..10, v=-10..10)}, WidthCount=10, HeightCount=10)  # -> Mesh, Area; disabled
msphere = MeshSphere(Base=PlaneXY(0, 0, 0), Radius=10, UCount=10, VCount=20)  # disabled
mbox = MeshBox(Base={Plane=PlaneXY(0, 0, 0), X=Domain(-10, 10), Y=Domain(-10, 10), Z=Domain(-10, 10)}, XCount=10, YCount=10, ZCount=10)  # disabled
vmoments = VolumeMoments()  # -> Volume, Centroid, Inertia, InertiaError, Secondary, SecondaryError, Gyration; disabled
recgrid = Rectangular(Plane=PlaneXY(0, 0, 0), SizeX=1, SizeY=2, ExtentX=10, ExtentY=5)  # -> Cells, Points; disabled
sqgrid = Square(Plane=PlaneXY(0, 0, 0), Size=1, ExtentX=5, ExtentY=5)  # -> Cells, Points; disabled
hexgrid = Hexagonal(Plane=PlaneXY(0, 0, 0), Size=1, ExtentX=5, ExtentY=5)  # -> Cells, Points; disabled
kscope = Kaleidoscope(Plane=PlaneXY(0, 0, 0), Segments=10)  # -> Geometry, Transform; disabled
aligndim = AlignedDimension(Plane=PlaneXY(0, 0, 0), Offset=1, Text="{0:0.00}", Size=1)  # disabled
linedim = LineDimension(Text="{0:0.00}", Size=1)  # disabled
lineardim = LinearDimension(Text="{0:0.00}", Size=1)  # disabled
cospherical = CoSpherical(Strength=1)  # disabled
crossref = CrossReference(CrossMode=1)  # -> ListA, ListB; disabled
short = ShortestList(TrimMode=2)  # -> ListA, ListB; disabled
long = LongestList(PaddingMode=2)  # -> ListA, ListB; disabled
transpose = TransposeMatrix()  # disabled
minvert = InvertMatrix(Tolerance=0)  # -> Matrix, Success; disabled
ccx = CurveCurve()  # -> Points, ParamsA, ParamsB; disabled
cx = CurveSelf()  # -> Points, Params; disabled
mcx = MultipleCurves()  # -> Points, IndexA, IndexB, ParamA, ParamB; disabled
msphereex = MeshSphereEx(Base=PlaneXY(0, 0, 0), Radius=10, Count=5)  # disabled
curvepoint = PointOnCurve(parameter=0.5)  # disabled
brep_cp = BrepClosestPoint()  # -> Point, Normal, Distance; disabled
srf_cp = SurfaceClosestPoint()  # -> Point, UVPoint, Distance; disabled
eval = EvaluateCurve()  # -> Point, Tangent, Angle; disabled
curvature = Curvature()  # -> P, K, C; disabled
int = Integer()  # disabled
bool = Boolean()  # disabled
num = Number()  # disabled
cull_i = CullIndex(Wrap=True)  # disabled
cull = CullPattern(CullPattern=[False, False, True, True])  # disabled
culln = CullNth(CullFrequency=2)  # disabled
radgrid = Radial(Plane=PlaneXY(0, 0, 0), Size=1, ExtentR=5, ExtentP=20)  # -> Cells, Points; disabled
trigrid = Triangular(Plane=PlaneXY(0, 0, 0), Size=1, ExtentX=5, ExtentY=5)  # -> Cells, Points; disabled
mirror = Mirror(Plane=PlaneYZ(0, 0, 0))  # -> Geometry, Transform; disabled
move = Move(Motion=Vector(0, 0, 10))  # -> Geometry, Transform; disabled
orient_2 = Orient(Source=PlaneXY(0, 0, 0), Target=PlaneXY(0, 0, 0))  # -> Geometry, Transform; disabled
markdim = MarkerDimension(Text="Z={2:0.0}", Size=1)  # disabled
serialdim = SerialDimension(Text="{0:0.00}", Size=1)  # disabled
collider = Collider(Radii=1, Strength=1)  # disabled
cc = CurveCollide(BasePlane=PlaneXY(0, 0, 0), Strength=1)  # -> Goal, Frames; disabled
cpc = CurvePointCollide(Plane=PlaneXY(0, 0, 0), Interior=False, Strength=1)  # disabled
swapr = SwapRows()  # disabled
swapc = SwapColumns()  # disabled
bbx = BrepBrep()  # -> Curves, Points; disabled
bcx = BrepCurve()  # -> Curves, Points; disabled
scx = SurfaceCurve()  # -> Curves, Points, UVPoints, Normals, Parameters, Tangents; disabled
txt = Text()  # disabled
hull = ConvexHull(Plane=PlaneXY(0, 0, 0))  # -> Hull, HullZ, Indices; disabled
del = DelaunayMesh(Plane=PlaneXY(0, 0, 0))  # disabled
con = DelaunayEdges(Plane=PlaneXY(0, 0, 0))  # -> Connectivity, Edges; disabled
brepinc = PointInBrep(Strict=False)  # disabled
shapein = ShapeInBrep()  # disabled
brepsinc = PointInBreps(Strict=False)  # -> Inside, Index; disabled
reduce = RandomReduce(Seed=1)  # disabled
frame = CurveFrame()  # disabled
cdiv = Derivatives()  # -> Point, FirstDerivative; disabled
hframe = HorizontalFrame()  # disabled
rotate = Rotate(Angle=1.570796327, Plane=PlaneXY(0, 0, 0))  # -> Geometry, Transform; disabled
rot3d = Rotate3D(Angle=1.570796327, Center=Point(0, 0, 0), Axis=Vector(0, 0, 1))  # -> Geometry, Transform; disabled
rotax = RotateAxis(Angle=1.570796327, Axis=Line((0, 0, 0), (10, 0, 0)))  # -> Geometry, Transform; disabled
angledim = AngularDimension(Reflex=False, Text="{0:0.0}°", Size=1)  # disabled
arcdim = ArcDimension(Offset=2, Text="{0:0.0}°", Size=1)  # disabled
angledimmesh = AngularDimensionsMesh(Text="{0:0.0}°", Size=1, LengthFactor=0.5)  # disabled
imgcircles = ImageCircles(Min=0.2, Max=1, Strength=1)  # disabled
spc = SolidPointCollide(Interior=False, Unidirectional=True, Strength=1)  # disabled
sc = SphereCollide(Radius=1, Strength=1)  # disabled
pop2d = Populate2D(Region={Plane=PlaneXY(0, 0, 0), Size=Domain2(u=0..20, v=0..10)}, Count=100, Seed=1)  # disabled
pop3d = Populate3D(Region={Plane=PlaneXY(0, 0, 0), X=Domain(0, 10), Y=Domain(0, 10), Z=Domain(0, 2)}, Count=100, Seed=1)  # disabled
popgeo = PopulateGeometry(Count=100, Seed=1)  # disabled
addition = Addition()  # disabled
division = Division()  # disabled
multiplication = Multiplication()  # disabled
col = Colour()  # disabled
culture = Culture()  # disabled
C = Complex()  # disabled
substrate = Substrate(Border={Plane=PlaneXY(0, 0, 0), Size=Domain2(u=0..20, v=0..5)}, Count=100, Angles=[0.1, 0.3, 0.5], Deviation=0, Seed=5)  # disabled
srfsplit = SurfaceSplit()  # disabled
triminc = PointInTrim()  # disabled
range = Range(Domain=Domain(0, 1), Steps=10)  # disabled
series = Series(Start=0, Step=1, Count=10)  # disabled
charseq = CharSequence(Count=10, CharPool="ABCDEFGHIJKLMNOPQRSTUVWXYZ", Format="{0}")  # disabled
moveaway = MoveAwayFrom(Distance=10)  # -> Geometry, Transform; disabled
movetoplane = MoveToPlane(Plane=PlaneXY(0, 0, 0), Above=True, Below=True)  # -> Geometry, Transform; disabled
rotate_2 = RotateDirection(Center=Point(0, 0, 0), From=Vector(1, 0, 0), To=Vector(0, 1, 0))  # -> Geometry, Transform; disabled
circledim = CircularDimension(Text="{0:0.0}°", Size=1)  # disabled
clamplength = ClampLength(LowerLimit=0, UpperLimit=10, Strength=1)  # disabled
ct = ConstantTension(Strength=1)  # disabled
direction = Direction(Strength=1)  # disabled
pframe = PerpFrame()  # disabled
torsion = Torsion()  # -> Point, Torsion; disabled
subtraction = Subtraction()  # disabled
neg = Negative()  # disabled
pow = Power()  # disabled
deplane = DeconstructPlane(Plane=PlaneXY(0, 0, 0))  # -> Origin, XAxis, YAxis, ZAxis; disabled
xy = XYPlane(Origin=Point(0, 0, 0))  # disabled
xz = XZPlane(Origin=Point(0, 0, 0))  # disabled
domain = Domain()  # disabled
domain² = Domain²()  # disabled
id = Guid()  # disabled
voronoi = Voronoi(BruteForceOverride=False)  # disabled
voronoi³ = Voronoi3D()  # -> Cells, Boundary; disabled
facet = FacetDome()  # -> Pattern, Dome; disabled
mcx_2 = MeshCurve()  # -> Points, Faces; disabled
mmx = MeshMesh()  # disabled
evalsrf = EvaluateSurface()  # -> Point, Normal, UDirection, VDirection, Frame; disabled
curvature_2 = SurfaceCurvature()  # -> Frame, Gaussian, Mean; disabled
osc = OsculatingCircles()  # -> Point, FirstCircle, SecondCircle; disabled
dup = DuplicateData(Number=2, Order=True)  # disabled
fib = Fibonacci(SeedA=0, SeedB=1, Number=10)  # disabled
repeat = RepeatData()  # disabled
matrix_3 = Matrix()  # disabled
time = Time()  # disabled
abs = Absolute()  # disabled
fac = Factorial()  # disabled
integer_division = IntegerDivision()  # disabled
blendbox = BlendBox()  # disabled
morph = BoxMorph()  # disabled
sbox = SurfaceBox(Height=1)  # disabled
make2d = Make2D(TangentEdges=False, TangentSeams=False, AutoComputeMake2D=False)  # -> VisibleCurves, VisibleIndex, VisibleType, HiddenCurves, HiddenIndex, HiddenType; disabled
m2d_parallel = Make2DParallelView()  # disabled
m2d_perspective = Make2DPerspectiveView()  # disabled
dw = DynamicWeight1d(Weight=1)  # disabled
equallength = EqualLength(Strength=1)  # disabled
length_line = LengthLine(Strength=10)  # disabled
eval_2 = EvaluateLength(Normalized=True)  # -> Point, Tangent, Parameter; disabled
len = Length()  # disabled
crvdom = CurveDomain()  # -> Curve, Domain; disabled
yz = YZPlane(Origin=Point(0, 0, 0))  # disabled
vcell = VoronoiCell()  # disabled
vorgroup = VoronoiGroups(Boundary={Plane=PlaneXY(0, 0, 0), Size=Domain2(u=-10..10, v=-10..10)})  # -> Diagram1, Diagram2; disabled
seq = Sequence(Notation="[N-1] + [N-2]", Length=20, Initial=[1, 1])  # disabled
stack = StackData(Data=["A", "B", "C", "D"], Stack=[1, 2, 3, 4])  # disabled
kuka_command = KUKAPrcCommand()  # disabled
data = Data()  # disabled
path = DataPath()  # disabled
curvature_3 = PrincipalCurvature()  # -> Frame, Max, Min, MaxDirection, MinDirection; disabled
clash = Clash(Distance=0, L=100)  # -> ClashCount, ClashPoints, ClashRadii, FirstIndex, SecondIndex; disabled
colmm = CollisionManyMany()  # -> Collision, Indices; disabled
colom = CollisionOneMany()  # -> Collision, Index; disabled
mod = Modulus()  # disabled
tbox_2 = TwistedBox()  # disabled
m2d_rhino = Make2DRhinoView(Clip=True)  # disabled
lengthratio = LengthRatio(Ratio=2, Strength=1)  # disabled
lengthsnap = LengthSnap(Factor=1, Strength=1)  # disabled
pl = PlasticLength(Limit=1, Strength=1)  # disabled
pl_2 = ConstructPlane(Origin=Point(0, 0, 0), XAxis=Vector(1, 0, 0), YAxis=Vector(0, 1, 0))  # disabled
pl_3 = PlaneNormal(Origin=Point(0, 0, 0), ZAxis=Vector(0, 0, 1))  # disabled
lnln = LineLine()  # disabled
lend = LengthDomain()  # disabled
lenp = LengthParameter()  # -> Length, Length_2; disabled
lenseg = SegmentLengths()  # -> ShortestLength, ShortestDomain, LongestLength, LongestDomain; disabled
oct = OcTree(Square=False, Group=5)  # -> Boxes, Points; disabled
prox = Proximity2D(Plane=PlaneXY(0, 0, 0), Group=5)  # -> Links, Topology; disabled
prox_2 = Proximity3D(Group=5)  # -> Links, Topology; disabled
path_2 = FilePath()  # disabled
shader = Shader()  # disabled
jitter = Jitter(Jitter=1, Seed=2)  # -> Values, Indices; disabled
random = Random(Range=Domain(0, 1), Number=1, Seed=2)  # disabled
ma = MassAddition()  # -> Result, PartialResults; disabled
reldif = RelativeDifferences()  # disabled
mm = MassMultiplication()  # -> Result, PartialResults; disabled
srf4pt = _4PointSurface()  # disabled
srfgrid = SurfaceFromPoints(Interpolate=False)  # disabled
trim = TrimWithBrep()  # -> Inside, Outside; disabled
trim_2 = TrimWithBreps()  # -> Inside, Outside; disabled
trim_3 = TrimWithRegion()  # -> Inside, Outside; disabled
bend = BendDeform()  # disabled
flow = Flow(ReverseBase=False, ReverseTarget=False, Stretch=True, Rigid=False)  # disabled
stretch = Stretch(Axis=Line((0, 0, 0), (10, 10, 0)), Length=20, Rigid=False)  # disabled
bar_graph = BarGraph(BarColor=RGB(255, 0, 90))  # disabled
legend = Legend(
    Colour=[RGB(211, 211, 211), RGB(105, 105, 105), RGB(128, 0, 0), RGB(0, 0, 128)],
    Tags=["One Fish", "Two Fish", "Red Fish", "Blue Fish"],
    LegendType=1)  # disabled
pie = PieChart()  # disabled
conical = Conicalize(Strength=1)  # disabled
cyclicquad = CyclicQuad(Strength=1)  # disabled
developablize = Developablize(Strength=1)  # disabled
qt = QuadTree(Plane=PlaneXY(0, 0, 0), Square=False, Group=5)  # -> Quads, Points; disabled
lnpt = LinePt()  # disabled
pl_3pt = Plane3Pt()  # disabled
plfit = PlaneFit()  # -> Plane, Deviation; disabled
cset = CreateSet()  # -> Set, Map; disabled
difference = SetDifference()  # disabled
exdiff = SetDifferenceS()  # disabled
incurve = PointInCurve()  # -> Relationship, Point; disabled
incurves = PointInCurves()  # -> Relationship, Index, Point; disabled
larger = LargerThan(SecondNumber=0)  # -> LargerThan, OrEqualTo; disabled
smaller = SmallerThan(SecondNumber=0)  # -> SmallerThan, OrEqualTo; disabled
equals = Equality()  # -> Equality, Inequality; disabled
boundary = BoundarySurfaces()  # disabled
loft = Loft(Options={Adjust=False, Closed=False, LoftEnds=0, LoftSimp=0, LoftType=0, Rebuild=10, Refit=0.01})  # disabled
cploft = ControlPointLoft(Degree=5)  # disabled
number_slider = Slider(0.25, range=0..1)  # disabled
trim_4 = TrimWithRegions()  # -> Inside, Outside; disabled
split_2 = SplitWithBrep()  # -> Curve, Points; disabled
split_3 = SplitWithBreps()  # -> Curve, Points; disabled
metaball = MetaBall(Plane=PlaneXY(0, 0, 0))  # disabled
metaball_t = MetaBallT(Plane=PlaneXY(0, 0, 0), Threshold=0.5)  # disabled
metaball_t_2 = MetaBallTCustom(Plane=PlaneXY(0, 0, 0), Threshold=0.5)  # disabled
intersection = SetIntersection()  # disabled
majority = SetMajority()  # disabled
sunion = SetUnion()  # disabled
pl_offset = PlaneOffset(BasePlane=PlaneXY(0, 0, 0), Offset=1)  # disabled
pl_origin = PlaneOrigin()  # disabled
similar = Similarity(Threshold=0.1)  # -> Similarity, AbsoluteDifference; disabled
twist = Twist(Angle=1.570796327, Infinite=False, Rigid=False)  # disabled
maelstrom = Maelstrom(Plane=PlaneXY(0, 0, 0), First=0.1, Second=10, Angle=1.570796327, Rigid=False)  # disabled
mirror_2 = MirrorCurve(Tangent=True)  # disabled
graph = QuickGraph(SortOrder=0)  # disabled
edgelengths = EdgeLengths(LengthFactor=1, Strength=1)  # disabled
hinge = Hinge(Strength=1)  # disabled
iso = Isothermic(Strength=1)  # disabled
divide_2 = DivideCurve(Count=10, Kinks=False)  # -> Points, Tangents, Parameters; disabled
shatter = Shatter()  # disabled
contour_3 = Contour(Point=Point(0, 0, 0), Direction=Vector(0, 0, 1))  # -> Contours, Parameters; disabled
edgesrf = EdgeSurface()  # disabled
fitloft = FitLoft(CountU=15, DegreeU=5, DegreeV=5)  # disabled
loft_opt = LoftOptions(Closed=False, Adjust=False, Rebuild=0, Refit=0, Type=0)  # disabled
sdiff = SolidDifference()  # disabled
sint = SolidIntersection()  # disabled
sunion_2 = SolidUnion()  # disabled
qrmesh = QuadRemesh(Settings={aqc=True, as=50, dhe=True, gci=0, null=False, pme=0, sa=0, tqc=2000})  # disabled
qrsettings = QuadRemeshSettings(TargetCount=1000, AdaptiveSize=0, AdaptiveCount=False, HardEdges=False, SeamEdges=0, Symmetry=0, GuideCurves=0)  # disabled
cprod = CarthesianProduct()  # disabled
subset_2 = SubSet()  # disabled
disjoint = Disjoint()  # disabled
digit_scroller = DigitScroller(Scroller_Digits=12, Scroller_Radix=9, Scroller_Value=0.25)  # disabled
mirror_3 = MirrorSurface(Frame=True)  # disabled
splop = Splop(Plane=PlaneXY(0, 0, 0), Angle=0, Rigid=False)  # disabled
sporph = Sporph(R=False)  # disabled
nofoldthrough = NoFoldThrough(Strength=1)  # disabled
planarize = Planarize(Strength=1)  # disabled
and = GateAnd()  # disabled
not = GateNot()  # disabled
or = GateOr()  # disabled
cp_2 = PlaneClosestPoint()  # -> Point, UVPoint, Distance; disabled
prot = RotatePlane()  # disabled
padjust = AdjustPlane(Normal=Vector(0, 0, 1))  # disabled
ls = LiveSoap(UseVolume=False, VolumeChange=0, Strength=1, Reset=False)  # disabled
netsurf = NetworkSurface(Continuity=2)  # disabled
rulesrf = RuledSurface()  # disabled
sumsrf = SumSurface()  # disabled
tracker = ValueTracker(TrackerAutoDomain=True, TrackerColour=RGB(255, 155, 0), TrackerPeriod=10, TrackerUpdate=25, TrackerDomain=[0, 1])  # disabled
gallery = ImageGallery(CycleDelay=30, Randomize=False, UseLocalImages=True, UseRemoteImages=True)
contour_4 = ContourEx(Plane=PlaneXY(0, 0, 0))  # -> Contours, Parameters; disabled
dash = DashPattern()  # -> Dashes, Gaps; disabled
divdist = DivideDistance()  # -> Points, Tangents, Parameters; disabled
toggle = BooleanToggle(False)  # disabled
knob = ControlKnob(Decimals=2, Limit=True, Maximum=10, Minimum=0, Range=1, Value=0.25)  # disabled
custom_mesh_settings = SettingsCustom(
    StitchSeams=True,
    SimplePlanes=False,
    Refine=True,
    MinCount=16,
    MaxCount=400,
    AspectRatio=20,
    MaxDistance=0,
    MaxAngle=20,
    MinEdge=0,
    MaxEdge=0)  # disabled
trim_5 = TrimSolid()  # disabled
bvol = BoundaryVolume()  # disabled
split_4 = SplitBrep()  # disabled
mesh_2 = MeshBrep(Settings={GridMaxCount=0, GridMinCount=16, JaggedSeams=False, MaxEdgeLength=0, MinEdgeLength=0.0001, MinTolerance=0, Refine=True, RefineAngle=0, RelativeTolerance=0.65, SimplePlanes=True, Tolerance=0})  # disabled
mindex = MemberIndex()  # -> Index, Count; disabled
replace_2 = ReplaceMembers()  # disabled
smooth = SettingsQuality()  # disabled
xor = GateXor()  # disabled
srfmorph = SurfaceMorph()  # disabled
taper = Taper(Flat=False, Infinite=False, Rigid=False)  # disabled
ph = PlasticHinge(Limit=0.1, Strength=1)  # disabled
polygonarea = PolygonArea(Strength=1)  # disabled
pressure = Pressure(Strength=1)  # disabled
align = AlignPlane()  # -> Plane, Angle; disabled
align_2 = AlignPlanes()  # disabled
pflip = FlipPlane(Plane=PlaneXY(0, 0, 0), ReverseX=False, ReverseY=False, SwapAxes=True)  # disabled
extr = Extrude()  # disabled
extrcrv = ExtrudeAlong()  # disabled
extrude = ExtrudeLinear(OrientationP=PlaneXY(0, 0, 0))  # disabled
divlength = DivideLength()  # -> Points, Tangents, Parameters; disabled
splitmul = SplitBrepMultiple()  # disabled
vote = GateMajority()  # disabled
nand = GateNand()  # disabled
nor = GateNor()  # disabled
dcon = DeleteConsecutive(Wrap=False)  # -> Set, Count; disabled
fsim = FindSimilarMember()  # -> Hit, Index; disabled
keysearch = KeyValueSearch()  # disabled
jagged = SettingsSpeed()  # disabled
mesh_uv = MeshSurface(UCount=5, VCount=5, Overhang=True, Equalize=False)  # disabled
smesh = SimpleMesh()  # disabled
md_slider = MDSlider(SliderMode=0, slider_value=Point(0.5, 0.5, 0.5), x_domain=Domain(0, 1), y_domain=Domain(0, 1), z_domain=Domain(0, 1))  # disabled
map_srf = MapToSurface()  # disabled
pdeform = PointDeform()  # disabled
deform = SpatialDeform()  # disabled
material = CreateMaterial(Diffuse=RGB(255, 105, 180), Specular=RGB(255, 255, 255), Emission=RGB(0, 0, 0), Transparency=0, Shine=0)  # disabled
preview = CustomPreview(Material={diffuse=RGB(221, 160, 221), emission=RGB(66, 48, 66), shine=0.5, specular=RGB(255, 255, 255), transparency=0})  # disabled
smooth_2 = Smooth(Strength=1)  # disabled
sg = SoapFilm(Strength=1)  # disabled
tsmooth = TangentialSmooth(Strength=1)  # disabled
button = Button()  # disabled
plcoord = PlaneCoordinates(System=PlaneXY(0, 0, 0))  # -> XCoordinate, YCoordinate, ZCoordinate; disabled
extr_2 = ExtrudePoint()  # disabled
list = ValueList({"One": 1, "Two": 2, "Three": 2² - 1, "Four": Sqrt(16)}, selected="One")  # disabled
xnor = GateXnor()  # disabled
hframes = HorizontalFrames(Count=10)  # -> Frames, Parameters; disabled
pframes = PerpFrames(Count=10, Align=True)  # -> Frames, Parameters; disabled
frames = CurveFrames(Count=10)  # -> Frames, Parameters; disabled
join = TextJoin()  # disabled
split_5 = TextSplit()  # disabled
chars = Characters()  # -> Result, Unicode; disabled
disjoint_2 = DisjointMesh()  # disabled
mjoin = MeshJoin()  # disabled
mblur = BlurMesh(Iterations=1)  # disabled
deform_2 = SpatialDeformCustom(Falloff="1.0/x")  # disabled
cloud = CloudDisplay(Colours=RGB(255, 20, 147), Size=1, SpriteType=0)  # disabled
dots = DotDisplay(Colour=RGB(0, 0, 0), Size=1)  # disabled
tangentincircles = TangentIncircles(Strength=1)  # disabled
vertexloads = VertexLoads(Strength=-0.1)  # disabled
volume_2 = Volume(Strength=1)  # disabled
rdiff = RegionDifference()  # disabled
rint = RegionIntersection()  # disabled
runion = RegionUnion()  # disabled
fpatch = FragmentPatch()  # disabled
patch = Patch(Spans=20, Flexibility=1, Trim=True)  # disabled
pt_2 = ConstructPoint(XCoordinate=0, YCoordinate=0, ZCoordinate=0)  # disabled
pdecon = Deconstruct()  # -> XComponent, YComponent, ZComponent; disabled
num2pt = NumbersToPoints(Numbers=[1, 2, 3], Mask=4)  # disabled
sqr = Square()  # disabled
sqrt = SquareRoot()  # disabled
cube = Cube()  # disabled
concat = Concatenate()  # disabled
len_2 = TextLength()  # disabled
comp = Compound()  # disabled
split_6 = Split()  # disabled
symadv = SymbolAdvanced(
    Style=11,
    SizePrimary=20,
    SizeSecondary=10,
    Rotation=0,
    Fill=RGB(154, 205, 50),
    Edge=RGB(0, 100, 0),
    Width=2,
    Adjust=False)  # disabled
symsim = SymbolSimple(Style=13, Size=12, Rotation=0, Colour=RGB(255, 105, 180))  # disabled
symbol = SymbolDisplay()  # disabled
wind = Wind(WindVector=Vector(1, 0, 0))  # disabled
cullf = CullFaces()  # disabled
cullv = CullVertices(Shrink=True)  # disabled
deletef = DeleteFaces()  # disabled
ln = Line()  # disabled
line_2 = LineSDL(Direction=Vector(0, 0, 1), Length=1)  # disabled
fline_2 = FitLine()  # disabled
gradient = Gradient(LowerLimit=0, UpperLimit=1, stops=[0.15: RGB(255, 130, 160), 0.85: RGB(220, 0, 40)])  # disabled
mdif = MeshDifference()  # disabled
mint = MeshIntersection()  # disabled
msplit = MeshSplit()  # disabled
calendar = Calendar()  # disabled
pipe = Pipe(Radius=1, Caps=0)  # disabled
swp1 = Sweep1(Miter=1)  # disabled
vpipe = PipeVariable(Caps=0)  # disabled
matrix_4 = TransformMatrix(Digits=3)  # disabled
pt2num = PointsToNumbers(Points=Point(1, 2, 3), Mask=4)  # disabled
image = ImageSampler(Filter="Colour", Interpolate=False, Umax=1, Umin=0, Vmax=1, Vmin=0, Wrap=1)  # disabled
cbrt = CubeRoot()  # disabled
transform_2 = Transform()  # disabled
points = PointList()  # disabled
order = PointOrder()  # disabled
oncurve = OnCurve(Strength=1)  # disabled
onmesh = OnMesh(Strength=1)  # disabled
onplane = OnPlane(Plane=PlaneXY(0, 0, 0), Strength=1)  # disabled
inverse = InverseTransform()  # disabled
format = Format(Culture=127)  # disabled
case = TextCase(Culture=127)  # -> UpperCase, LowerCase; disabled
fragment = TextFragment()  # disabled
deletev = DeleteVertices(Shrink=True)  # disabled
mshadow = MeshShadow(Light=Vector(0, 0, -1), Plane=PlaneXY(0, 0, 0))  # disabled
msplit_2 = MeshSplitPlane(Plane=PlaneXY(0, 0, 0))  # -> Above, Below; disabled
ln2pl = Line2Plane()  # disabled
ln4pt = Line4Pt()  # disabled
tan = TangentLines()  # -> Tangent1, Tangent2; disabled
swp2 = Sweep2(SameHeight=False)  # disabled
munion = MeshUnion()  # disabled
group = Group()  # disabled
vdis = VectorDisplay()  # disabled
vdisex = VectorDisplayEx(Colour=RGB(0, 0, 0), Width=2)  # disabled
_10º = PowerOf10()  # disabled
_2º = PowerOf2()  # disabled
one_over_x = OneOverX()  # disabled
ungroup = Ungroup()  # disabled
dist = Distance()  # disabled
pt_3 = PointOriented(BasePlane=PlaneXY(0, 0, 0), UComponent=0, VComponent=0, WComponent=0)  # disabled
bcentric = Barycentric(CoordinateU=1, CoordinateV=1, CoordinateW=1)  # disabled
B = Bomb(DetonationTime=100, Strength=5)  # disabled
anchor = Anchor(Strength=10000)  # disabled
anchorxyz = AnchorXYZ(X=False, Y=False, Z=False, Strength=1000)  # disabled
trim_6 = TextTrim(Start=True, End=True)  # disabled
msmooth = SmoothMesh(Strength=0.5, SkipNaked=True, Iterations=1)  # disabled
slits = BoxSlits(Gap=0)  # -> Breps, Topology; disabled
rslits = RegionSlits(Gap=0)  # -> Regions, Topology; disabled
gmerge = MergeGroup()  # disabled
gsplit = SplitGroup(Wrap=False)  # -> GroupA, GroupB; disabled
railrev = RailRevolution(Scale=False)  # disabled
revsrf = Revolution(Domain=Domain(0, 6.283185307))  # disabled
tanex = TangentLinesEx()  # -> Tangent1, Tangent2; disabled
tanin = TangentLinesIn()  # -> Tangent1, Tangent2; disabled
eº = PowerOfE()  # disabled
rep = ReplaceText(RecursiveReplace=False)  # disabled
tsort = SortText(Culture=127)  # -> Keys, Values; disabled
tmatch = MatchText(Case=True)  # disabled
pt_4 = PointCylindrical(BasePlane=PlaneXY(0, 0, 0), Angle=0, Radius=1, Elevation=0)  # disabled
pt_5 = PointPolar(BasePlane=PlaneXY(0, 0, 0), XYAngle=0, ZAngle=0, Offset=1)  # disabled
polar = ToPolar(System=PlaneXY(0, 0, 0))  # -> Phi, Theta, Radius; disabled
C_2 = Coincident(Strength=100)  # disabled
floor = Floor(Strength=1)  # disabled
colour = ColourPicker(PickedColour=RGB(159, 57, 128))  # disabled
clock = Clock(SecondHand=True)  # disabled
load = Load(ForceVector=Vector(0, 0, 1), Weighting=1)  # disabled
alignvert = AlignVertices(Tolerance=0.01)  # -> Result, Count; disabled
flipm = FlipMesh(VertexNormals=True, FaceNormals=True, FaceOrientation=True)  # disabled
quad_2 = Quadrangulate(Angle=0.03490658504, Ratio=0.875)  # -> Mesh, Count; disabled
swatch = ColourSwatch(SwatchColor=RGB(255, 255, 255))  # disabled
planesrf = PlaneSurface(Plane=PlaneXY(0, 0, 0), XSize=Domain(-10, 10), YSize=Domain(-10, 10))  # disabled
pxs = PlaneThroughShape(Inflate=1, SectionLogic=False)  # disabled
logn = LogN()  # disabled
log = Logarithm()  # disabled
ln_2 = NaturalLogarithm()  # disabled
tdist = TextDistance(Case=True)  # disabled
cir = Circle(Plane=PlaneXY(0, 0, 0), Radius=1)  # disabled
circle_2 = Circle3Pt()  # -> Circle, Plane, Radius; disabled
circle_3 = CircleCNR(Normal=Vector(0, 0, 1), Radius=1)  # disabled
cp_3 = ClosestPoint()  # -> ClosestPoint, CPIndex, Distance; disabled
pull = PullPoint(ClosestOnly=True)  # -> ClosestPoint, Distance; disabled
cps = ClosestPoints(Count=3)  # -> ClosestPoint, CPIndex, Distance; disabled
tri = Triangulate()  # -> Mesh, Count; disabled
unim = UnifyMesh()  # -> Result, Count; disabled
unweld = UnweldMesh(Angle=1.570796327)  # disabled
ms = MagnetSnap(Range=0.5, Strength=10)  # disabled
plasticanchor = PlasticAnchor(Limit=1, Strength=1, Reset=False)  # disabled
transform_3 = Transform(Strength=1)  # disabled
expression = Expression(Expression="Format(\"{0}, {1}\", x, y)")  # disabled
bbox = BoundingBox(Plane=PlaneXY(0, 0, 0))  # -> Box, Box_2; disabled
box_3 = CenterBox(Base=PlaneXY(0, 0, 0), X=1, Y=1, Z=1)  # disabled
box_4 = Box2Pt(Plane=PlaneXY(0, 0, 0))  # disabled
flatten = FlattenTree(Path="{0}")  # disabled
graft = GraftTree(IncludeEmptyLists=True, IncludeNullItems=True)  # disabled
trim_7 = TrimTree(Depth=1)  # disabled
wheel = ColourWheel(
    ColourGrips_Style=31,
    ColourGrips_Grip=[0, 2.094395102, 4.188790205, 3.141592654],
    ColourGrips_Lum=[0.1, 0.5],
    ColourGrips_Range=[0.2617993878, 0.2617993878, 0.2617993878, 0.2617993878],
    ColourGrips_Sat=[0.2, 0.6])  # disabled
graph_2 = GraphMapper()  # disabled
fcircle = CircleFit()  # -> Circle, Radius, Deviation; disabled
circlett = CircleTanTan()  # disabled
circlettt = CircleTanTanTan()  # disabled
cullpt = CullDuplicates(Tolerance=0.1, CullMode=3)  # -> Points, Indices, Valence; disabled
pgroups = PointGroups()  # -> Groups, Indices; disabled
project_2 = ProjectPoint(Direction=Vector(0, 0, -1))  # -> Point, Index; disabled
weld = WeldMesh(Angle=3.141592654)  # disabled
eval_3 = Evaluate()  # disabled
boxrec = BoxRectangle(Height=Domain(0, 10))  # disabled
box_5 = DomainBox(Base=PlaneXY(0, 0, 0), X=Domain(-2, 2), Y=Domain(-0.5, 0.5), Z=Domain(0, 0.25))  # disabled
bouncysolver = BouncySolver(Reset=False, Threshold=1e-15, Tolerance=0.01, Damping=0.99, Iterations=10, On=True)  # -> I, V, O; disabled
grab = Grab(On=True, Strength=1, Range=3)  # disabled
show = Show()  # disabled
unflatten = UnflattenTree()  # disabled
clean = CleanTree(RemoveNulls=True, RemoveInvalid=True, RemoveEmpty=False)  # disabled
prune = PruneTree(Minimum=0, Maximum=0)  # disabled
exposure = Exposure(Lambert=False)  # -> Exposure, Range; disabled
occ = Occlusion()  # -> Hits, Occlusion; disabled
alongcrv = SortAlongCurve()  # -> Points, Indices; disabled
sort_pt = SortPoints()  # -> Points, Indices; disabled
ellipse = Ellipse(Plane=PlaneXY(0, 0, 0), Radius1=1, Radius2=1)  # -> Ellipse, Focus1, Focus2; disabled
incircle = InCircle()  # -> Circle, Plane, Radius; disabled
inellipse = InEllipse()  # -> Ellipse, Plane; disabled
cyl = Cylinder(Base=PlaneXY(0, 0, 0), Radius=0.5, Length=1)  # disabled
sph = Sphere(Base=PlaneXY(0, 0, 0), Radius=1)  # disabled
cone = Cone(Base=PlaneXY(0, 0, 0), Radius=0.5, Length=1)  # -> Cone, Tip; disabled
c_script = CSharpScript()  # -> Out, A; disabled
python = GhPythonScript()  # -> Out, A; disabled
vb = VBScript()  # -> Out, A; disabled
soft_hardsolver = SoftHardSolver(HardIterations=10, SoftMultiplier=1, Reset=False, Threshold=1e-15, Tolerance=0.01, On=True)  # -> I, V, O; disabled
solver = Solver(Reset=False, Threshold=1e-15, Tolerance=0.01, On=True)  # -> I, V, O; disabled
stepsolver = StepSolver(Tolerance=0.01, Momentum=False, Damping=0.99, SubIterations=10)  # -> I, V, O; disabled
simplify = SimplifyTree(Front=False)  # disabled
tstat = TreeStatistics()  # -> Paths, Length, Count; disabled
image_resource = ImageResource()  # disabled
_3dm = Import3DM(Layer="*", Name="*")  # disabled
atom = AtomData()  # -> Point, Element, Chain, Residue, Charge, Occupancy, Temperature, AtomicNumber, SerialNumber, ResidueNumber; disabled
devec = DeconstructVector()  # -> XComponent, YComponent, ZComponent; disabled
vec_2 = VectorXYZ(XComponent=0, YComponent=0, ZComponent=0)  # -> Vector, Length; disabled
arc_2 = Arc3Pt()  # -> Arc, Plane, Radius; disabled
arc_3 = ArcSED()  # -> Arc, Plane, Radius; disabled
arc_4 = Arc(Plane=PlaneXY(0, 0, 0), Radius=1, Angle=Domain(0, 3.141592654))  # -> Arc, Length; disabled
qsph = QuadSphere(Base=PlaneXY(0, 0, 0), Radius=1)  # disabled
sph4pt = Sphere4Pt()  # -> Center, Radius, Sphere; disabled
sfit = SphereFit()  # -> Center, Radius, Sphere; disabled
date = ConstructDate(Year=2021, Month=1, Day=12, Hour=12, Minute=0, Second=0)  # disabled
time_2 = ConstructTime(Hour=14, Minute=18, Second=0)  # disabled
dateex = ConstructExoticDate(Calendar=0)  # disabled
entwine = Entwine(FlattenInputs=True)  # disabled
bang = ExplodeTree()  # -> Branch0, Branch1; disabled
flip = FlipMatrix()  # disabled
zombiesolver = ZombieSolver(Threshold=1e-10, Tolerance=0.01, MaxIterations=50000)  # -> I, V, O; disabled
unit = UnitVector()  # disabled
X = UnitX(Factor=1)  # disabled
Y = UnitY(Factor=1)  # disabled
coords = ImportCoordinates(Separator=",", XIndex=0, YIndex=1, ZIndex=2)  # disabled
pdb = ImportPDB()  # -> Atoms, Bonds; disabled
img = ImportImage()  # disabled
meshsubd = MeshFromSubD(Density=2)  # disabled
subdmesh = SubDFromMesh(Creases=1, Corners=1, Interpolate=False)  # disabled
biarc = BiArc(Ratio=0.5)  # -> FirstArc, SecondArc, BiArc; disabled
modarc = ModifiedArc()  # disabled
tarc = TangentArcs()  # -> ArcA, ArcB; disabled
smtime = ConstructSmoothTime(Days=0, Hours=0, Minutes=0, Seconds=0)  # disabled
ddate = DeconstructDate(Date=637460579004925029)  # -> Year, Month, Day, Hour, Minute, Second; disabled
merge = Merge()  # disabled
Z = UnitZ(Factor=1)  # disabled
shp = ImportSHP()  # -> Points, Curves, Regions; disabled
objdet = ObjectDetails()  # -> Referenced, Available, Name, Layer, Colour, Guid; disabled
file = ReadFile(PerLineParse=True)  # disabled
fuse = SubDFuse(BooleanOption=0, Smoothing=10)  # disabled
subdpoly = SubDControlPolygon()  # disabled
subdedges = SubDEdges(NewFormatting=False)  # -> Line, Edge, Tag, Id; disabled
cdate = CombineDateTime()  # disabled
rdate = DateRange(Count=10)  # disabled
intdate = InterpolateDate(Interpolation=0)  # disabled
path_mapper = PathMapper()  # disabled
polygon = Polygon(Plane=PlaneXY(0, 0, 0), Radius=3, Segments=6, FilletRadius=0)  # -> Polygon, Length; disabled
poledge = PolygonEdge(Segments=6)  # -> Polygon, Centre, CornerRadius, EdgeRadius; disabled
rectangle = Rectangle(Plane=PlaneXY(0, 0, 0), XSize=Domain(-1, 1), YSize=Domain(-2, 2), Radius=0)  # -> Rectangle, Length; disabled
pshift = ShiftPaths(Offset=-1)  # disabled
match = MatchTree()  # disabled
byparent = ByParent(Level=1)  # disabled
checkerboard = Checkerboard()  # disabled
clean_2 = CombineClean()  # disabled
vec2pt = Vector2Pt(Unitize=False)  # -> Vector, Length; disabled
vlen = VectorLength()  # disabled
amp = Amplitude(Amplitude=1)  # disabled
cos = Cosine()  # disabled
sin = Sine()  # disabled
sinc = Sinc()  # disabled
sdivide = DivideSurface(UCount=10, VCount=10)  # -> Points, Normals, Parameters; disabled
sframes = SurfaceFrames(UCount=10, VCount=10)  # -> Frames, Parameters; disabled
# Doubleclick Me!
viewer = ParamViewer()  # disabled
item_2 = CherryPicker(ListIndex=0)  # disabled
rec_2pt = Rectangle2Pt(Plane=PlaneXY(0, 0, 0), PointA=Point(0, 0, 0), PointB=Point(10, 5, 0), Radius=0)  # -> Rectangle, Length; disabled
rec_3pt = Rectangle3Pt()  # -> Rectangle, Length; disabled
split_7 = SplitTree()  # -> Positive, Negative; disabled
diag = Diagonalize()  # disabled
faceface = FaceFaceOffset(Distance=1)  # -> Offset, Beams; disabled
foldangle = FoldAngle()  # disabled
tan_2 = Tangent()  # disabled
angle_2 = Angle()  # -> Angle, Reflex; disabled
xprod = CrossProduct(Unitize=False)  # -> Vector, Length; disabled
dprod = DotProduct(Unitize=False)  # disabled
trim_8 = CopyTrim()  # disabled
subsrf = Isotrim()  # disabled
retrim = Retrim()  # disabled
filter = StreamFilter(Gate=0)  # disabled
gate = StreamGate(Gate=0)  # -> Target0, Target1; disabled
bzspan = BezierSpan()  # -> Curve, Length, Domain; disabled
intcrv = Interpolate(Degree=3, Periodic=False, KnotStyle=1)  # -> Curve, Length, Domain; disabled
nurbs = NurbsCurve(Degree=3, Periodic=False)  # -> Curve, Length, Domain; disabled
acos = ArcCosine()  # disabled
asin = ArcSine()  # disabled
atan = ArcTangent()  # disabled
rev_2 = Reverse()  # disabled
vrot = Rotate()  # disabled
hingepoints = HingePoints()  # -> _1, _2, _3, _4; disabled
mc = MeshCorners(Angle=2.35619449)  # disabled
md = MeshDirection()  # disabled
untrim = Untrim()  # disabled
csc = CoSecant()  # disabled
cot = CoTangent()  # disabled
sec_3 = Secant()  # disabled
relitem = RelativeItem(WrapPaths=False, WrapItems=False)  # -> ItemA, ItemB; disabled
relitem2 = RelativeItems(WrapPaths=False, WrapItems=False)  # -> ItemA, ItemB; disabled
branch = TreeBranch(MaintainPaths=True)  # disabled
pline = PolyLine(Closed=False)  # disabled
intcrv_t = InterpolateT(TangentStart=Vector(0, 0, 0), TangentEnd=Vector(0, 0, 0), KnotStyle=1)  # -> Curve, Length, Domain; disabled
kinkcrv = KinkyCurve(Degree=3, Angle=0.1745329252)  # -> Curve, Length, Domain; disabled
join_2 = BrepJoin()  # -> Breps, Closed; disabled
cap = CapHoles()  # disabled
capex = CapHolesEx()  # -> Brep, Caps, Solid; disabled
meshmap = MeshMap(Distance=1)  # disabled
turn = MeshTurn()  # disabled
nv = NakedVertices()  # -> ClothedIndex, NakedIndex, ClothedPts, NakedPts; disabled
deg = Degrees()  # disabled
rad = Radians()  # disabled
rec_2 = DataRecorder(DataLimit=-10, RecordData=False)  # disabled
item_3 = TreeItem(Index=0, Wrap=True)  # disabled
dam = DataDam(BufferDelay=10000000, BufferMode=0)  # disabled
relay = Relay()  # disabled
fmerge = MergeFaces()  # -> Breps, Before, After; disabled
parc = PolyArc(Closed=False)  # disabled
tancurve = TangentCurve(Blend=0.5, Degree=3)  # -> Curve, Length, Domain; disabled
rtrig = RightTrigonometry()  # -> Alpha, Beta, PLength, QLength, RLength; disabled
trig = TriangleTrigonometry()  # -> Alpha, Beta, Gamma, ALength, BLength, CLength; disabled
remeshbycolour = RemeshByColour(LengthInterval=Domain(0.5, 2), Flip=1, Iterations=1, Reset=True)  # disabled
trigger = Trigger(Interval=-1000, TimerInterval=1000)  # disabled
path_3 = ConstructPath()  # disabled
dpath = DeconstructPath()  # disabled
compare = PathCompare(Mask="*")  # disabled
refine = Refine(Level=1)  # disabled
strips = RefineStrips(Level=1)  # disabled
suirify = Suirify()  # disabled
flip_2 = Flip()  # -> Surface, Result; disabled
offset = OffsetSurface(Distance=0, Retrim=True)  # disabled
offset_l = OffsetSurfaceLoose(Distance=0, Retrim=True)  # disabled
crvsrf = CurveOnSurface(Closed=False)  # -> Curve, Length, Domain; disabled
geodesic = Geodesic()  # disabled
iso_2 = IsoCurve()  # -> UIsocurve, VIsocurve; disabled
replace_3 = ReplacePaths(Search="*")  # disabled
simpleremesh = SimpleRemesh(Length=1, Steps=50)  # disabled
tc = TangentCircles()  # -> Incircles, CirclePacking, Dual; disabled
stripper = Stripper()  # disabled
centroid = Centroid()  # -> Centroid, MedianAB, MedianBC, MedianCA; disabled
ccentre = Circumcentre()  # -> Circumcentre, BisectorAB, BisectorBC, BisectorCA; disabled
icentre = Incentre()  # -> Incentre, BisectorA, BisectorB, BisectorC; disabled
edgespt = EdgesFromPoints(Valence=1)  # -> Edges, Indices, Map; disabled
filedge = FilletEdge(Blend=0, Metric=0)  # disabled
edgescvx = ConvexEdges()  # -> Convex, Concave, Mixed; disabled
output = ClusterOutput()  # disabled
input = ClusterInput()  # disabled
input_2 = DataInput(UpdateDelay=50000)  # disabled
subcrv = SubCurve()  # disabled
tweencrv = TweenCurve(Factor=0.5, BlendType=0)  # disabled
ocentre = Orthocentre()  # -> Orthocentre, AltitudeAB, AltitudeBC, AltitudeCA; disabled
unroller = Unroller(Unroll=1)  # disabled
vn = VertexNeighbours()  # -> Vertex, Neighbours, Normal; disabled
warpweft = WarpWeft()  # -> Warp, Weft, NakedA, NakedB; disabled
edgesdir = EdgesFromDirections(Reflex=True, Angle=0)  # -> Edges, Indices, Map; disabled
edgesfaces = EdgesFromFaces()  # -> Edges, Indices; disabled
edgeslen = EdgesFromLength(Minimum=0, Maximum=100)  # -> Edges, Indices; disabled
output_2 = DataOutput()  # disabled
knots = KnotVector(Degree=3, Periodic=False)  # disabled
nurbcrv = NurbsCurvePWK()  # -> Curve, Length, Domain; disabled
eps = Epsilon(Factor=1)  # disabled
phi = GoldenRatio(Factor=1)  # disabled
E = NaturalLogarithm(Factor=1)  # disabled
dot = DotDisplay()  # disabled
inter = InterconnectPoints()  # disabled
mb = MöbiusTransformation(Circle={Plane=PlaneXY(0, 0, 0), Radius=1}, T=0.7853981634, Q=0, FixSphere=False)  # disabled
edgeslin = EdgesFromLinearity(Minimum=0, Maximum=1)  # -> Edges, Indices; disabled
genes = GenePool(Decimals=2, Maximum=100, Minimum=0, Value=[50, 50, 50, 50, 50, 50, 50, 50, 50, 50])  # disabled
galapagos = Galapagos()
lscape = FitnessLandscape(Count=-1, ColourMode=1, ContourMode=2, Remap=False)  # disabled
dupln = RemoveDuplicateLines(Tolerance=0.01)  # disabled
duppt = RemoveDuplicatePts(Tolerance=0.01)  # disabled
splitatcorners = SplitAtCorners(Angle=1)  # -> Corners, Parts; disabled
pi = Pi(Factor=1)  # disabled
blendc = BlendCurve(BulgeA=1, BulgeB=1, Continuity=2)  # disabled
cat = Catenary(Gravity=Vector(0, 0, -1))  # disabled
blendcpt = BlendCurvePt(Continuity=2)  # disabled
extrz = Extremes()  # -> Mininum, Maximum; disabled
max = Maximum()  # disabled
min = Minimum()  # disabled
connect = ConnectCurves(Continuity=2, Close=True, Bulge=1)  # disabled
round = Round()  # -> Nearest, Floor, Ceiling; disabled
explode = Explode(Recursive=True)  # -> Segments, Vertices; disabled
ext = ExtendCurve(Type=0)  # disabled
flip_3 = FlipCurve()  # -> Curve, Flag; disabled
avr = Average()  # disabled
interp = InterpolateData(Interpolation=2)  # disabled
nblur = BlurNumbers(Strength=0.5, Iterations=1, Lock=True, Wrap=False)  # disabled
smooth_3 = SmoothNumbers(SmoothDelay=2000)  # disabled
trunc = Truncate(TruncationFactor=0)  # disabled
wav = WeightedAverage()  # disabled
join_3 = JoinCurves(Preserve=False)  # disabled
arg = ComplexArgument()  # disabled
complex = ComplexComponents()  # -> Real, Imaginary; disabled
complex_conjugate = ComplexConjugate()  # disabled
fillet = Fillet()  # disabled
offset_2 = OffsetCurve(Distance=1, Plane=PlaneXY(0, 0, 0), Corners=1)  # disabled
fillet_2 = Fillet()  # -> Curve, Parameter; disabled
cmod = ComplexModulus()  # disabled
complex_2 = CreateComplex(Real=0, Imaginary=0)  # disabled
fillet_3 = FilletDistance()  # disabled
offset_l_2 = OffsetCurveLoose(Distance=1)  # disabled
offsets = OffsetOnSrf(Distance=1)  # disabled
project_3 = Project(Direction=Vector(0, 0, 1))  # disabled
pull_2 = PullCurve()  # disabled
seam = Seam()  # disabled
topoly = CurveToPolyline(ToleranceDistance=0, ToleranceAngle=0)  # -> Polyline, Segments; disabled
fit = FitCurve()  # disabled
pcol = PolylineCollapse(Tolerance=1)  # -> Polyline, Count; disabled
reb = RebuildCurve(Count=10, Tangents=False)  # disabled
redpline = Reduce(Tolerance=1)  # -> Polyline, Reduction; disabled
simplify_2 = SimplifyCurve()  # -> Curve, Simplified; disabled
smoothpline = SmoothPolyline(Strength=1, Times=1)  # disabled

# ==== cluster Colourful: Display objects in bright colours
geo = ClusterInput()
geo_2 = Geometry(geo)
clean = CleanTree(RemoveNulls=True, RemoveInvalid=True, RemoveEmpty=False, Tree=flatten(geo_2))
S = Shader([{diffuse=RGB(11, 125, 222), emission=RGB(3, 38, 67), shine=0.5, specular=RGB(255, 255, 255), transparency=0}, {diffuse=RGB(222, 37, 11), emission=RGB(67, 11, 3), shine=0.5, specular=RGB(255, 255, 255), transparency=0}, {diffuse=RGB(71, 222, 11), emission=RGB(21, 67, 3), shine=0.5, specular=RGB(255, 255, 255), transparency=0}, {diffuse=RGB(222, 194, 11), emission=RGB(67, 58, 3), shine=0.5, specular=RGB(255, 255, 255), transparency=0}])
lng = ListLength(List=clean)
repeat = RepeatData(Data=S, Length=lng)
preview = CustomPreview(Geometry=clean, Shader=repeat)
